# Grasshopper definition osc-position.gh (Grasshopper 1.0.7)
# plug-ins: gHowl

udp_receiver = UDPReceiver(Port=Slider(4001, range=0..10000), Pattern=Slider(999, range=0..1000))  # -> Info, Data
partition_list = PartitionList(List=udp_receiver.Data, Size=Slider(4, range=0..10))
list_item = ListItem(List=partition_list, Index=0, Wrap=True)  # -> Item, Item1, Item2, Item3
construct_point = ConstructPoint(XCoordinate=list_item.Item1, YCoordinate=list_item.Item2, ZCoordinate=list_item.Item3)
